% Simulink data dictionary test4.sldd

Sigmoid_Scope = 5
Simple_HZ = 10
Sigmoid_Range = 2
Current_Torque_ratio = -10
Torque_Range = 0.001
Motor_P = 10
Slope_Compare = 0.2
Step = 0.0001
Max_Current = 10
Min_Current = 0
Motor_D = 2
Motor_I = 0.5
Motor_speed = 0